# Grasshopper definition ExtendObjectTest.ghx (Grasshopper 1.0.7)
# plug-ins: Speckle 2

cso = CreateSpeckleObject(A="/Original", B="/Original", C="/Original")  # -> Debug, SpeckleObject
eso = ExtendSpeckleObject(SpeckleObject=cso.SpeckleObject, Keys="name", Values="New")
eso_2 = ExpandSpeckleObject(SpeckleObject=eso)  # -> A, B, C
